# Dynamo graph generator3.dyn (Dynamo 1.2.1.3083)

python_script = Python()  # unwired: IN[0]
# ---------- python_script.python (72 lines) ----------
import sys

sys.path += ['C:\Program Files (x86)\JetBrains\PyCharm Community Edition 2017.1\helpers', 'C:\Program Files (x86)\IronPython 2.7\Lib']

import clr
clr.AddReference('ProtoGeometry')
clr.AddReference('RevitAPI')
clr.AddReference('RevitAPIUI')
clr.AddReference("RevitServices")
clr.AddReference("RevitNodes")

import generator3

path = 'C:\Users\gary\Desktop\ironpython-stubs'
generator3.quiet = False

modules = ['Autodesk.DesignScript.Geometry',
'Autodesk.DesignScript.Geometry.TSpline',

'Autodesk.Revit.ApplicationServices',
'Autodesk.Revit.Attributes',
'Autodesk.Revit.Creation',
'Autodesk.Revit.Exceptions',
'Autodesk.Revit.Utility',

'Autodesk.Revit.DB',
'Autodesk.Revit.DB.Analysis',
'Autodesk.Revit.DB.Architecture',
'Autodesk.Revit.DB.Electrical',
'Autodesk.Revit.DB.Events',
'Autodesk.Revit.DB.ExtensibleStorage',
'Autodesk.Revit.DB.ExternalService',
'Autodesk.Revit.DB.Fabrication',
'Autodesk.Revit.DB.IFC',
'Autodesk.Revit.DB.Lighting',
'Autodesk.Revit.DB.Macros',
'Autodesk.Revit.DB.Mechanical',
'Autodesk.Revit.DB.Plumbing',
'Autodesk.Revit.DB.PointClouds',
'Autodesk.Revit.DB.Structure',
'Autodesk.Revit.DB.Structure.StructuralSections',

'Autodesk.Revit.UI',
'Autodesk.Revit.UI.Events',
'Autodesk.Revit.UI.Macros',
'Autodesk.Revit.UI.Mechanical',
'Autodesk.Revit.UI.Plumbing',
'Autodesk.Revit.UI.Selection',

'RevitServices.Persistence',
'RevitServices.Transactions',
	
'Revit.Application',
'Revit.Elements',
'Revit.Elements.Views',
'Revit.Filter',
'Revit.GeometryConversion',
'Revit.GeometryObjects',
'Revit.Transaction',
'Revit.References',
'Revit.AnalysisDisplay',

'System',
'System.Boolean',
'System.Collections',
'System.Collections.Generic',
'System.IO',
'System.String',
'System.Treading']

for i in list(modules):
    generator3.process_one(i, None, True, path)
# ----------------------------------------
